# Dynamo graph Image_to_Revit_demo.dyn (Dynamo 2.19.3.6394)

file_path = Filename("C:\Users\lenihar\Downloads\image_anomaly_markers.xlsx")
file_from_path = FileObject(path=file_path)
code_block = CodeBlock { "image_anomaly_markers"; }
boolean = BoolSelector(false)
boolean_2 = BoolSelector(true)
importExcel = Data.ImportExcel(file=file_from_path, sheetName=code_block, readAsStrings=boolean, showExcel=boolean_2)
code_block_2 = CodeBlock(x=importExcel) { x[1]; }
code_block_3 = CodeBlock(x=code_block_2) { x[4]; x[5]; }
code_block_4 = CodeBlock { 0; }
code_block_5 = CodeBlock { "PositionMarker"; }
python_script = Python(IN[0]=code_block_3.out0, IN[1]=code_block_3.out1, IN[2]=code_block_4, IN[3]=code_block_5, IN[4]=code_block_5)  # CPython3
# ---------- python_script.python (99 lines) ----------
import clr

clr.AddReference("RevitServices")
from RevitServices.Persistence import DocumentManager
from RevitServices.Transactions import TransactionManager

clr.AddReference("RevitAPI")
from Autodesk.Revit.DB import *
from Autodesk.Revit.DB import Structure

# Dynamo unwrap support (safe even if not used)
clr.AddReference("RevitNodes")
import Revit
clr.ImportExtensions(Revit.Elements)

doc = DocumentManager.Instance.CurrentDBDocument

def first(x):
    return x[0] if isinstance(x, list) else x

def as_float(x):
    return float(first(x))

def get_type_name(symbol):
    # Avoid symbol.Name (can fail in Dynamo); use built-in parameter instead
    p = symbol.get_Parameter(BuiltInParameter.SYMBOL_NAME_PARAM)
    return p.AsString() if p else None

def get_family_name(symbol):
    # Avoid symbol.Family.Name; use built-in parameter instead
    p = symbol.get_Parameter(BuiltInParameter.ALL_MODEL_FAMILY_NAME)
    return p.AsString() if p else None

# --- Inputs ---
easting_m   = as_float(IN[0])
northing_m  = as_float(IN[1])
elevation_m = as_float(IN[2])

family_or_type = first(IN[3])
type_name_in   = first(IN[4]) if len(IN) > 4 else None

# --- Convert metres -> internal feet ---
e_ft = UnitUtils.ConvertToInternalUnits(easting_m, UnitTypeId.Meters)
n_ft = UnitUtils.ConvertToInternalUnits(northing_m, UnitTypeId.Meters)
z_ft = UnitUtils.ConvertToInternalUnits(elevation_m, UnitTypeId.Meters)

shared_pt = XYZ(e_ft, n_ft, z_ft)

# --- Shared -> Project transform (same approach as your macro) ---
transform = doc.ActiveProjectLocation.GetTotalTransform()
project_pt = transform.OfPoint(shared_pt)

# --- Resolve FamilySymbol ---
symbol = None

# Case A: user passed a Dynamo Family Type node
try:
    unwrapped = UnwrapElement(family_or_type)
    if isinstance(unwrapped, FamilySymbol):
        symbol = unwrapped
except:
    pass

# Case B: user passed family/type names as strings
if symbol is None:
    fam_name_in = str(family_or_type) if family_or_type is not None else None
    typ_name_in = str(type_name_in) if type_name_in is not None else None

    if fam_name_in and typ_name_in:
        for fs in FilteredElementCollector(doc).OfClass(FamilySymbol):
            fn = get_family_name(fs)
            tn = get_type_name(fs)
            if fn == fam_name_in and tn == typ_name_in:
                symbol = fs
                break

# --- Place instance ---
TransactionManager.Instance.EnsureInTransaction(doc)

inst = None
msg = None

if symbol is None:
    msg = "ERROR: Could not resolve FamilySymbol. Use a 'Family Types' node or provide exact family/type strings."
else:
    if not symbol.IsActive:
        symbol.Activate()

    inst = doc.Create.NewFamilyInstance(
        project_pt,
        symbol,
        Structure.StructuralType.NonStructural
    )
    msg = "Placed OK"

TransactionManager.Instance.TransactionTaskDone()

# Output both for debugging
OUT = (inst, msg, project_pt)
# ----------------------------------------
code_block_6 = CodeBlock(x=python_script) { x[0]; }
code_block_7 = CodeBlock { ["image_name","latitude","longitude","mga_zone","easting_m","northing_m","llm_response"]; }

# group: Whoops! Unnecessary complication :(
code_block_8 = CodeBlock(x=code_block_2)
# ---------- code_block_8.designscript (5 lines) ----------
//i accidentally created some of the parameters as strings
//so i have a painful conversion of 3 of the values to strings
//
//
[x[0],String.FromObject(x[1]),String.FromObject(x[2]),String.FromObject(x[3]),x[4],x[5],x[6]];
# ----------------------------------------

setParameterByName = Element.SetParameterByName(element=code_block_6, parameterName=code_block_7, value=code_block_8)
